# Grasshopper definition Example_01.gh (Grasshopper 1.0.8)
# plug-ins: GH_Calcpad

cp_info = CalcpadInfo()  # -> PluginInfo, CalcpadInfo

# ----
# 1. LOAD CPD
example_01 = FilePath("D:\06_PROGRAMMING\01_Visual Studio\01_GH_Calcpad\GH_Calcpad\Examples\Example_01.cpd")
loadcpd = LoadCPD(FilePath=example_01, Freeze=False)  # -> Variables, Values, Units, SheetObj
variables = Panel(loadcpd.Variables)
values = Panel(loadcpd.Values)
units = Panel(loadcpd.Units)

panel = Panel(cp_info.PluginInfo)
panel_2 = Panel(cp_info.CalcpadInfo)

# ----
# 2. RUN CPD
playcpd = PlayCPD(Sheet=loadcpd.SheetObj)  # -> Sheet, Elapsed, Success

# ----
# 3. VIEW NEW VALUES
panel_3 = Panel("""R
S
T
V""")
searchres = SearchResults(Sheet=playcpd.Sheet, FilterNames=panel_3)  # -> Equations, Values, Units
equations = Panel(searchres.Equations)
values_2 = Panel(searchres.Values)
units_2 = Panel(searchres.Units)
