# Grasshopper definition Example_03.gh (Grasshopper 1.0.8)
# plug-ins: GH_Calcpad

cp_info = CalcpadInfo()  # -> PluginInfo, CalcpadInfo

# ----
# 1. LOAD CPD
example_03 = FilePath("D:\06_PROGRAMMING\01_Visual Studio\01_GH_Calcpad\GH_Calcpad\Examples\Example_03.cpd")
loadcpd = LoadCPD(FilePath=example_03, Freeze=False)  # -> Variables, Values, Units, SheetObj
variables = Panel(loadcpd.Variables)
values = Panel(loadcpd.Values)
units = Panel(loadcpd.Units)

panel = Panel(cp_info.PluginInfo)
panel_2 = Panel(cp_info.CalcpadInfo)

# ----
# 2. CHANGED IN VALUES
number_slider = Slider(200, range=0..1000)
searchvars = SearchVariables(Sheet=loadcpd.SheetObj, NewValues=number_slider)  # -> Sheet, ModifiedNames, ModifiedValues, NotFound
panel_3 = Panel(searchvars.ModifiedNames)
panel_4 = Panel(searchvars.ModifiedValues)

# ----
# 3. RUN CPD
playcpd = PlayCPD(Sheet=searchvars.Sheet)  # -> Sheet, Elapsed, Success
panel_5 = Panel(playcpd.Elapsed)

# ----
# 5. EXPORT
toggle = BooleanToggle(False)
directory = FilePath("D:\06_PROGRAMMING\01_Visual Studio\01_GH_Calcpad\GH_Calcpad\Examples\")
exportword = ExportWord(Sheet=playcpd.Sheet, File="New-example", OutputFolder=directory, Execute=toggle)  # -> WordPath, Success
exportpdf = ExportPDF(Sheet=playcpd.Sheet, File="New-example", OutputFolder=directory, Execute=toggle)  # -> PDFPath, Success

# ----
# 4. VIEW NEW VALUES
searchres = SearchResults(Sheet=playcpd.Sheet)  # -> Equations, Values, Units
equations = Panel(searchres.Equations)
values_2 = Panel(searchres.Values)
units_2 = Panel(searchres.Units)
