# Grasshopper definition Example_04-Optimization.gh (Grasshopper 1.0.8)
# plug-ins: GH_Calcpad

cp_info = CalcpadInfo()  # -> PluginInfo, CalcpadInfo

# ----
# 1. LOAD CPD
example_04_optimization = FilePath("D:\06_PROGRAMMING\01_Visual Studio\01_GH_Calcpad\GH_Calcpad\Examples\Example_04-Optimization.cpd")
loadcpd = LoadCPD(FilePath=example_04_optimization, Freeze=False)  # -> Variables, Values, Units, SheetObj
variables = Panel(loadcpd.Variables)
values = Panel(loadcpd.Values)
units = Panel(loadcpd.Units)

panel = Panel(cp_info.PluginInfo)
panel_2 = Panel(cp_info.CalcpadInfo)

# ----
# 2. CHANGED IN VALUES
number_slider = Slider(1000, range=0..1000)
number_slider_2 = Slider(1000, range=0..1000)
merge = Merge(Data1=number_slider_2, Data2=number_slider)
searchvars = SearchVariables(Sheet=loadcpd.SheetObj, NewValues=merge)  # -> Sheet, ModifiedNames, ModifiedValues, NotFound
panel_3 = Panel(searchvars.ModifiedNames)
panel_4 = Panel(searchvars.ModifiedValues)

# ----
# 3. RUN CPD
playcpd = PlayCPD(Sheet=searchvars.Sheet)  # -> Sheet, Elapsed, Success
panel_5 = Panel(playcpd.Elapsed)

# ----
# 4. OPTIMIZATION
galapagos = Galapagos(fitness=ghc_area, gene=[number_slider, number_slider_2])

# ----
# 7. EXPORT
toggle = BooleanToggle(False)
directory = FilePath("D:\06_PROGRAMMING\01_Visual Studio\01_GH_Calcpad\GH_Calcpad\Examples\")
exportword = ExportWord(Sheet=playcpd.Sheet, File="New-example", OutputFolder=directory, Execute=toggle)  # -> WordPath, Success
exportpdf = ExportPDF(Sheet=playcpd.Sheet, File="New-example", OutputFolder=directory, Execute=toggle)  # -> PDFPath, Success

# ----
# 5. VIEW NEW VALUES
searchres = SearchResults(Sheet=playcpd.Sheet)  # -> Equations, Values, Units
equations = Panel(searchres.Equations)
values_2 = Panel(searchres.Values)
units_2 = Panel(searchres.Units)

# ----
# 6. SELECT  OBJETIVE/S
item = ListItem(List=searchres.Values, Index=0, Wrap=True)  # -> Item, Item1, Item2
ghc_util_defl = Number(item.Item2)
ghc_area = Number(item.Item)
ghc_util_bending = Number(item.Item1)
panel_6 = Panel(ghc_area)
panel_7 = Panel(ghc_util_bending)
panel_8 = Panel(ghc_util_defl)
